# Grasshopper definition maze.gh (Grasshopper 1.0.7)
# plug-ins: Kangaroo2 Components

# ---- group: RH_IN:width
number_slider = Slider(8, range=0..10)

# ---- group: RH_IN:length
number_slider_2 = Slider(8, range=0..10)

# ----
width = GetNumber(number_slider, AtLeast=1, AtMost=1, Maximum=1.797693135e+308, Minimum=-1.797693135e+308)
length = GetNumber(number_slider_2, AtLeast=1, AtMost=1, Maximum=1.797693135e+308, Minimum=-1.797693135e+308)
square = Square(Plane=PlaneXY(0, 0, 0), Size=Slider(10, range=0..10), ExtentX=width, ExtentY=length)  # -> flatten(Cells), Points

# ---- group: RH_IN:seed value
number_slider_3 = Slider(1, range=0..10)

# ----
list_length = ListLength(List=square.Cells)
seed_value = GetNumber(number_slider_3, AtLeast=1, AtMost=1, Maximum=1.797693135e+308, Minimum=-1.797693135e+308)
random = Random(Range=Domain(0, 1), Number=list_length, Seed=seed_value, Integers=True)
dispatch = Dispatch(List=square.Cells, DispatchPattern=random)  # -> ListA, ListB
explode = Explode(Curve=dispatch.ListA, Recursive=True)  # -> Segments, Vertices
explode_2 = Explode(Curve=dispatch.ListB, Recursive=True)  # -> Segments, Vertices
bounding_box = BoundingBox(Content=square.Cells, Plane=PlaneXY(0, 0, 0), UnionBox=True)  # -> Box, Box_2
area = Area(Geometry=bounding_box.Box)  # -> Area, Centroid
list_item = ListItem(List=explode.Segments, Index=0, Wrap=True)  # -> Item, Item1, Item2, Item3
list_item_2 = ListItem(List=explode_2.Segments, Index=0, Wrap=True)  # -> Item, Item1, Item2, Item3
scale = Scale(Geometry=bounding_box.Box, Center=area.Centroid, Factor=Slider(1.05, range=0..10))  # -> Geometry, Transform
number_slider_4 = Slider(7, range=0..10)
unit_x = UnitX(Factor=1)
unit_y = UnitY(Factor=1)
point_on_curve = PointOnCurve(list_item_2.Item, parameter=0.5)
point_on_curve_2 = PointOnCurve(list_item_2.Item3, parameter=0.5)
point_on_curve_3 = PointOnCurve(list_item.Item, parameter=0.5)
point_on_curve_4 = PointOnCurve(list_item.Item1, parameter=0.5)
divide_surface = DivideSurface(Surface=scale.Geometry, UCount=number_slider_4, VCount=number_slider_4)  # -> flatten(Points), flatten(Normals), Parameters
arc_sed = ArcSED(Start=point_on_curve_3, End=point_on_curve_4, Direction=unit_y)  # -> Arc, Plane, Radius
arc_sed_2 = ArcSED(Start=point_on_curve_2, End=point_on_curve, Direction=unit_x)  # -> Arc, Plane, Radius
list_item_3 = ListItem(List=explode_2.Vertices, Index=[Slider(3, range=0..10), Slider(1, range=0..100)], Wrap=True)
list_item_4 = ListItem(List=explode.Vertices, Index=[Slider(2, range=0..10), Slider(0, range=0..100)], Wrap=True)
number_slider_5 = Slider(15, range=0..100)
polyline = PolyLine(Vertices=list_item_4, Closed=False)
polyline_2 = PolyLine(Vertices=list_item_3, Closed=False)
list_length_2 = ListLength(List=divide_surface.Points)
construct_domain = ConstructDomain(DomainStart=Slider(4, range=0..10), DomainEnd=number_slider_5)
mirror_curve = MirrorCurve(Geometry=arc_sed.Arc, Curve=polyline, Tangent=True)
mirror_curve_2 = MirrorCurve(Geometry=arc_sed_2.Arc, Curve=polyline_2, Tangent=True)
random_2 = Random(Range=construct_domain, Number=list_length_2, Seed=Slider(4, range=0..10))
addition = Addition(A=number_slider_4, B="1")
join_curves = JoinCurves(Curves=[mirror_curve, arc_sed.Arc, arc_sed_2.Arc, mirror_curve_2], Preserve=False)
number_slider_6 = Slider(0.6, range=0..1)
amplitude = Amplitude(Vector=divide_surface.Normals, Amplitude=random_2)
curve = Curve(join_curves)
negative = Negative(Value=number_slider_6)
move = Move(Geometry=divide_surface.Points, Motion=amplitude)  # -> Geometry, Transform
offset_curve = OffsetCurve(Curve=curve, Distance=negative, Corners=1)
pipe = Pipe(Curve=square.Cells, Radius=Slider(3, range=0..10), Caps=0)  # -> flatten(Pipe)
offset_curve_2 = OffsetCurve(Curve=curve, Distance=number_slider_6, Corners=1)
negative_2 = Negative(Value=number_slider_5)
surface_from_points = SurfaceFromPoints(Points=move.Geometry, UCount=addition, Interpolate=False)
loft = Loft(
    Curves=[offset_curve_2, offset_curve],
    Options={Adjust=False, Closed=False, LoftEnds=0, LoftSimp=0, LoftType=0, Rebuild=10, Refit=0.01})
unit_z = UnitZ(Factor=negative_2)
unit_z_2 = UnitZ(Factor=Slider(30, range=0..100))
extrude = Extrude(Base=surface_from_points, Direction=unit_z)
extrude_2 = Extrude(Base=loft, Direction=unit_z_2)
split_brep = SplitBrep(Brep=extrude, Cutter=scale.Geometry)
list_item_5 = ListItem(List=split_brep, Index=0, Wrap=True)
cap_holes = CapHoles(Brep=list_item_5)
solid_intersection = SolidIntersection(BrepsA=extrude_2, BrepsB=cap_holes)
solid_difference = SolidDifference(BrepsA=solid_intersection, BrepsB=pipe)
mesh = Mesh(solid_difference)
clean = CombineClean(Meshes=mesh)
medges = MeshEdges(Mesh=clean)  # -> NakedEdges, InteriorEdges, NonManifoldEdges
join = JoinCurves(Curves=medges.NakedEdges, Preserve=medges.NakedEdges)
join_2 = JoinCurves(Curves=medges.InteriorEdges, Preserve=False)
merge = Merge(Data1=join, Data2=join_2)  # -> flatten(Result)
curvepoint = PointOnCurve(merge, parameter=0.5)
pt = ConstructPoint(XCoordinate=0, YCoordinate=0, ZCoordinate=0)
pull = PullPoint(Point=curvepoint, Geometry=pt, ClosestOnly=True)  # -> ClosestPoint, Distance
bnd = Bounds(Numbers=pull.Distance)
remap = RemapNumbers(Value=pull.Distance, Source=bnd, Target=Domain(0, 1))  # -> Mapped, Clipped
gradient = Gradient(
    LowerLimit=0,
    UpperLimit=1,
    Parameter=remap.Mapped,
    stops=[0: RGB(0, 34, 255), 0.333: RGB(45, 139, 230), 0.625: RGB(128, 211, 232), 1: RGB(204, 236, 255)])
c_script = CSharpScript(crv=merge, color=gradient)  # -> out, A; inputs crv: Curve, color: Color
# ---------- c_script: C# ----------
    var c = color.R + "," + color.G + "," + color.B;
    crv.SetUserString("color", c);
    A = crv;
# ---------- end c_script ----------

# ---- group: RH_OUT:edges
curve_2 = Curve(flatten(c_script.A))
